# Dynamo graph List.WindowByHost.dyn (Dynamo 0.8.1.1942)

categories = Categories("Windows")
all_elements_of_category = ElementsOfCategory(categories)
host = Custom[Element.Host]()  # Gets an element's host
groupByKey = GroupByKey(all_elements_of_category, host)
count = Count(groupByKey, lacing=Longest)
firstItem = List.FirstItem(groupByKey, lacing=Longest)
host_2 = Custom[Element.Host](Element_s=firstItem, lacing=Longest)
name = WallType.Name(host_2)
